# Grasshopper definition p201.gh (Grasshopper 1.0.7)

md_slider = MDSlider(
    SliderMode=0,
    slider_value=Point(0.4968764476, 0.5297023825, 0.5),
    x_domain=Domain(0, 1),
    y_domain=Domain(0, 1),
    z_domain=Domain(0, 1))
ghpython_script = GhPythonScript(slider=md_slider)  # -> out, point, grid_segmented, a; inputs slider: Point3d
# ---------- ghpython_script: Python ----------
import math
import Rhino.Geometry as rg
import rhinoscriptsyntax as rs
import ghpythonlib.components as gh

class Triangrid:
    def __init__(self, plane, size, x_count, y_count):
        self.plane = plane
        self.size = size
        self.x_count = x_count
        self.y_count = y_count
        self.curves = self.grid_gen()
        
#    def get_guid(self, curve):
#        guid = rs.MoveObject(curve, [0,0,0])
#        return guid
        
    def grid_gen(self):
        grid = gh.Triangular(self.plane, self.size, self.x_count, self.y_count)[0]
        return grid
        
    def grid_merge(self):
        union = gh.RegionUnion(self.curves)
        return union
        
    def grid_centroid(self, curve):
        centroid = rs.CurveAreaCentroid(curve)[0]
        return centroid
        
    def grid_scaled(self, curve, origin, factor):
        scaled = gh.Scale(curve, origin, factor)[0]
        return scaled
        
    def grid_segment(self, curve, scaled):
        segmented = rs.AddLoftSrf([curve, scaled])
        return segmented
        
    def grid_deconstruct(self, curve):
        curve_list = gh.DeconstructBrep(curve)[1]
        return curve_list  
        
    def surface_gen(self, curve):
        surface = gh.BoundarySurfaces(curve)
        return surface
        
    def surface_reparam(self):
        base_srf = self.surface_gen(self.grid_merge())
        base_srf = rs.coercesurface(base_srf)
        domain = rg.Interval(0.00, 1.00)
        base_srf.SetDomain(0, domain)
        base_srf.SetDomain(1, domain)
        return base_srf
        
    def surface_eval(self, u, v):
        point = rs.EvaluateSurface(self.surface_reparam(), u, v)
        return point

if __name__ == '__main__':
    SCALE = 0.0001
    PLANE = rg.Plane.WorldXY
    triangles = Triangrid(PLANE, 3, 13, 8)
    point = triangles.surface_eval(slider[0], slider[1])
    
    grid_scaled = []
    grid_segmented = []
    for t_curve in triangles.curves:
        centroid = triangles.grid_centroid(t_curve)
        scaled = triangles.grid_scaled(t_curve, centroid, SCALE)
        
        triangle_line_list = triangles.grid_deconstruct(t_curve)
        scaled_line_list = triangles.grid_deconstruct(scaled)
        for i in range(len(scaled_line_list)):
            segmented = triangles.grid_segment(triangle_line_list[i], scaled_line_list[i])[0]
            grid_segmented.append(segmented)
# ---------- end ghpython_script ----------
triangular = Triangular(Plane=PlaneXY(0, 0, 0), Size=Slider(3, range=0..10), ExtentX=Slider(13, range=0..100), ExtentY=Slider(8, range=0..100))  # -> flatten(Cells), Points
panel = Panel(ghpython_script.a)
area = Area(Geometry=triangular.Cells)  # -> Area, Centroid
boundary_surfaces = BoundarySurfaces(Edges=triangular.Cells)
curve = Curve(ghpython_script.a)
region_union = RegionUnion(Curves=triangular.Cells)
md_slider_2 = MDSlider(
    SliderMode=0,
    slider_value=Point(0.4892852367, 0.5493293658, 0.5),
    x_domain=Domain(0, 1),
    y_domain=Domain(0, 1),
    z_domain=Domain(0, 1))
evaluate_surface = EvaluateSurface(Surface=reparameterize(region_union), Point=md_slider_2)  # -> Point, Normal, UDirection, VDirection, Frame
scale = Scale(Geometry=boundary_surfaces, Center=area.Centroid, Factor=Slider(0.0001, range=0..1))  # -> Geometry, Transform
deconstruct_brep = DeconstructBrep(Brep=flatten(boundary_surfaces))  # -> Faces, graft(Edges), Vertices
deconstruct_brep_2 = DeconstructBrep(Brep=flatten(scale.Geometry))  # -> Faces, graft(Edges), Vertices
loft = Loft(
    Curves=[deconstruct_brep.Edges, deconstruct_brep_2.Edges],
    Options={Adjust=False, Closed=False, LoftEnds=0, LoftSimp=0, LoftType=0, Rebuild=10, Refit=0.01})
area_2 = Area(Geometry=loft)  # -> Area, Centroid

# ---- group: rotate degree
construct_domain = ConstructDomain(DomainStart=Slider(53, range=0..720), DomainEnd=Slider(0, range=0..100))

# ----
distance = Distance(PointA=area_2.Centroid, PointB=evaluate_surface.Point)
bounds = Bounds(Numbers=flatten(distance))
remap_numbers = RemapNumbers(Value=distance, Source=bounds, Target=construct_domain)  # -> Mapped, Clipped
panel_2 = Panel(bounds)
rotate_axis = RotateAxis(Geometry=loft, Angle=graft(degrees(remap_numbers.Mapped)), Axis=deconstruct_brep.Edges)  # -> Geometry, Transform
