# Grasshopper definition p205.gh (Grasshopper 1.0.7)
# plug-ins: Kangaroo2 Components

number_slider = Slider(8, range=0..10)
number_slider_2 = Slider(8, range=0..10)
number_slider_3 = Slider(8, range=0..10)
ghpython_script = GhPythonScript(x=number_slider, y=number_slider, z=number_slider)  # -> out, sphere_base, sphere
# ---------- ghpython_script: Python ----------
import math
import Rhino.Geometry as rg
import rhinoscriptsyntax as rs
import ghpythonlib.components as gh

class Box:
    def __init__(self, x, y, z):
        self.plane = rg.Plane.WorldXY
        self.x = x
        self.y = y
        self.z = z
        self.size = self.get_size()
        self.box = self.box_gen()
        
    def get_size(self):
        size_dict = {'x':self.x, 'y':self.y, 'z':self.z}
        return size_dict
        
    def box_gen(self):
        box = gh.CenterBox(self.plane, self.size['x'], self.size['y'], self.size['z'])
        return box
        
    def box_array(self):
        boxes = gh.BoxArray(self.box, self.box, self.size['x'], self.size['y'], self.size['z'])[0]
        return boxes
        
    def box_union(self, boxes):
        return gh.SolidUnion(boxes)


class Sphere:
    def __init__(self, radius):
        self.radius = radius
        
    def sphere_gen(self, base):
        sphere = gh.Sphere(base, self.radius)
        return sphere


if __name__ == "__main__":
    box = Box(x,y,z)
    boxes = box.box_array()
    boxes_union = box.box_union(boxes)
    
    RAD = 43
    COUNT = 6
    SEED = 35
    sphere_base = gh.PopulateGeometry(boxes_union, COUNT, SEED)
    sphere = Sphere(RAD).sphere_gen(sphere_base)
# ---------- end ghpython_script ----------
center_box = CenterBox(Base=PlaneXY(0, 0, 0), X=number_slider_2, Y=number_slider_2, Z=number_slider_2)
box_array = BoxArray(Geometry=center_box, Cell=center_box, XCount=number_slider_3, YCount=number_slider_3, ZCount=number_slider_3)  # -> Geometry, Transform
solid_union = SolidUnion(Breps=box_array.Geometry)
populate_geometry = PopulateGeometry(Geometry=solid_union, Count=Slider(6, range=0..10), Seed=Slider(35, range=0..100))
sphere = Sphere(Base=populate_geometry, Radius=Slider(43, range=0..100))
brep = Brep(solid_union)
geometry = Geometry(box_array.Geometry)
volume = Volume(Geometry=geometry)  # -> Volume, Centroid
solid_difference = SolidDifference(BrepsA=brep, BrepsB=sphere)
point_in_brep = PointInBrep(Brep=solid_difference, Point=volume.Centroid, Strict=False)
cull_pattern = CullPattern(List=geometry, CullPattern=point_in_brep)
brep_wireframe = BrepWireframe(Brep=cull_pattern, Density=-1)
removeduplicatelines = RemoveDuplicateLines(Lines=flatten(brep_wireframe), Tolerance=0.01)
pipe = Pipe(Curve=removeduplicatelines, Radius=Slider(0.7, range=0..1), Caps=Slider(2, range=0..10))
custom_preview = CustomPreview(Geometry=pipe, Material=ColourSwatch(SwatchColor=RGB(255, 255, 255)))
