# Grasshopper definition sortedLR.gh (Grasshopper 1.0.7)

curve = Curve(<curve referenced from the Rhino model>)
ghpython_script = GhPythonScript(boundary=curve)  # -> out, vertices, centroid, pt1, pt2, bounding; inputs boundary: Curve
# ---------- ghpython_script: Python ----------
import Rhino.Geometry as rg
import rhinoscriptsyntax as rs
import ghpythonlib.components as gh

vertices = rs.CurvePoints(boundary)
centroid = rs.CurveAreaCentroid(boundary)[0]

pt1 = rs.AddPoint(vertices[0][0],vertices[1][1], 0)
pt2 = rs.AddPoint(vertices[4][0], vertices[7][1], 0)

bounding = rg.Rectangle3d(rg.Plane.WorldXY, rs.PointCoordinates(pt1), rs.PointCoordinates(pt2))
# ---------- end ghpython_script ----------
panel = Panel(ghpython_script.pt1)
